vi "802.11 Host.gvi"   [LabVIEW Communications System Design Suite 2.0.1]
outputs:
  "Has been transferred?": bool
  "Is header?": bool
  "chain table": u64[8]
  "chain order": u8[8]
  "PiggyBack Address": u8[6]
  "Head Mac Address": u8[6]
  "Check the ID": u8
  "Check if it is matching?": bool
  "chain table_2": u64[8]
  "Order in Chain": u8
  "Piggy": u64
  "Index of Max ID": i32
panel controls:
  "Trigger TX": bool
  "Clear events": bool
  "Operation Mode": T2 = "RF Multi Station"
  "Primary Subband": UFXP(2.0) = 1
  "Transmit IP Address": string = "10.230.208.238"
  "Transmit Port": u16 = 12345
  "Receive Port": u16 = 12345
  "Tab": i32 = 1
  "Power Level [dBm]": f64
  "TX Frequency [Hz]": f64 = 2500000000
  "Destination MAC Address": u8[6] = [71, 111, 75, 117, 109, 95]
  "Device MAC Address": u8[6] = [71, 111, 75, 117, 109, 98]
  "TX Port (USRP only)": enum{"TX1/RF 0", "TX1/RF 1"} = "TX1/RF 0"
  "RX Port (USRP only)": T3 = "RX2/RF 1"
  "AGC": bool
  "Manual RX gain [dB]": f64 = 37.5
  "PN Data Packet Size": i32 = 1000
  "Subcarrier Format": i32 = "20 MHz (IEEE 802.11 a)"(0)
  "Stop": bool
  "RIO Device": string = "RIO0"
  "Station": bool = TRUE
  "reset TX staistics": bool
  "reset RX staistics": bool
  "PN Packets per Second": u32 = 1
  "Transmit ACK": bool = TRUE
  "All": bool
  "None": bool
  "Events to Track": T5
  "CCA Energy Detection Threshold [dBm]": FXP(10.3) = -72
  "MCS": UFXP(4.0) = 4
  "session": "802.11 Host Session.gtype" = {"PN packet"=[213, 53, 221, 201, 159, 117, 42, 242, 69, 136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], "USRP session"={"Data Clock Rate"=120000000, "Radio Settings Bus Semaphore"=-1747976188, "DB Queues"=[refnum, refnum], "Characterization Data Valid?"=TRUE, "EEPROM Header"={"Checksum"=0, "Product Code"=30509, "Hardware Current Version"=6, "Hardware Oldest Compatible Version"=4, "EEPROM Map Current Version"=2, "EEPROM Map Oldest Compatible Version"=2, "User Password"="", "Pointer to Factory Header"=64, "Pointer to User Header"=4294967295, "Recommended Interval"=24, "Number of Reserved Bytes"=9, "Number of Daughterboards"=2, "Daughterboard IDs"=[103, 103], "Daughterboard Serial Numbers"=["3095095\u0000\u0000", "3095076\u0000\u0000"]}, "Device Data Header"={"Checksum"=0, "Number of Channels"=4, "Number of Gain Settings"=[1, 1, 1, 1], "Pointer to Characterization Data"=[192, 11720, 17512, 29040], "Number of Reserved Bytes"=27, "Number of Frequencies"=[480, 241, 480, 241]}, "EEPROM Characterization Header"={"Checksum"=0, "Date"=2015-06-18T01:02:52Z, "Temperature"=25, "Misc. Info"="", "Pointer to Device Data Header"=128, "Number of Reserved Bytes"=28}, "Characterization Data"=[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], "FPGA Current Version"=3, "FPGA Oldest Compatible Version"=3, "Fixed Logic Current Version"=4, "Fixed Logic Oldest Compatible Version"=1, "FPGA Radio Settings Bus Current Version"=2, "FPGA Radio Settings Bus Oldest Compatible Version"=2, "FPGA Board Config Current Version"=2, "FPGA Board Config Oldest Compatible Versio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
  "Data Source Option": i32 = 1
  "Data Sink Options": i32
  "Data Source": enum{"UDP", "PN Data", "Manual"} = "PN Data"
  "Data Sink": enum{"Off", "UDP"} = "Off"
  "Reference Clock": string = "Internal"
  "USRP bandwidth": "USRP bandwidth.gtype" = "40 MHz"
  "WiMAC FPGA Ref": any
  "CW Max": u16 = 16
  "CW Min": u16 = 16
  "Fixed backoff value": u16 = 60000
  "Fixed backoff?": bool
  "Exponential Backoff Ratio": UFXP(6.10) = 2
  "time to wait for decoding packet": u32 = 1000
  "Backoff: CW Max": T13 = "CW Max"
  "Backoff: CW Min": T13 = "CW Min"
  "Backoff: Exponential Backoff Ratio": enum{"Default", "Exponential Backoff Ratio"} = "Exponential Backoff Ratio"
  "Backoff: Fixed Backoff Value": T13 = "Fixed Backoff Value"
  "Backoff: Fixed Backoff?": T14 = "Fixed Backoff?"
  "Piggyback: Enable Piggyback": T14 = "Enable Piggyback?"
  "Piggyback: Piggyback Address": enum{"Default", "Piggyback MAC Address"} = "Piggyback MAC Address"
  "Enable Piggyback": bool = TRUE
  "Use RTR instead of Data?": bool
  "Set Backoff Done Pulse to False": bool
  "Flow ID": u8
  "Address 1": u8[6] = [71, 111, 75, 117, 109, 98]
  "Address 2": u8[6] = [71, 111, 75, 117, 109, 99]
  "Address 3": u8[6] = [71, 111, 75, 117, 109, 100]
  "Address 4": u8[6] = [71, 111, 75, 117, 109, 101]
  "Address 5": u8[6] = [71, 111, 75, 117, 109, 102]
  "Address 6": u8[6] = [71, 111, 75, 117, 109, 103]
  "Address 7": u8[6] = [71, 111, 75, 117, 109, 103]
  "Address 8": u8[6] = [71, 111, 75, 117, 109, 105]
  "Queue threshold for contention": u32 = 15
  "reset permission to contend": bool
  "packet size plus ICP header (bytes)": u32 = 1020
  "custom session": "Custom session.gtype" = {"H2T TX Data FIFO: actual depth"=4001792}
panel indicators:
  "Events": string
  "MAC TX Statistic": T1
  "Baseband Power": f64
  "Coerced LO frequency TX [Hz]": f64
  "Coerced LO frequency RX [Hz]": f64
  "Channel Estimation": cluster{"Element 1": i32[], "Element 2": f64[]}[]
  "TX Block Error Rate": f64
  "Coerced Power Level [dBm]": f64
  "RX Throughput": f64
  "Applied RX Gain [dB]": f64
  "RX Throughput [bits/s]": f64
  "Current TX Block Error Rate (BLER)": f64
  "RX Frequency [Hz]": f64
  "Overwritten by Device MAC Address": bool
  "Station Active": bool
  "Device Ready": bool
  "Baseband RX Power [dBFS]": f64
  "RX Constellation": c128[]
  "RX Power Spectrum": T4
  "TX Power Spectrum": T4
  "Data Transfer": bool
  "FIFO Full": bool
  "FIFO Full": bool
  "Data Transfer": bool
  "Compensated CFO [Hz]": f64
  "TX Data Dropped": bool
  "modulation and coding rate": string
  "MAC RX Statistic": T11
  "Target FIFO Overflow": bool
  "RF Input Power": f64[][]
  "CW and Backoff Indicators": T12
  "data after sifs count": u8
  "enable piggyback register": u32
  "count piggyback": u32
  "authorized to contend?": bool
  "Host queue length (packets)": i32
  "FPGA queue length": u32
  "DMA FIFO: empty elements remaining": u32
  "QL of H2T TX Data FIFO (packets)": i32
  "QL of send queue (packets)": i32
types:
  T1 = cluster{"TX after SIFS Requests Detected": u32, "TX after SIFS Requests Completed": u32, "TX after Backoff Requests Detected": u32, "TX after Backoff Requests Completed": u32}
  T2 = enum{"Baseband Loopback", "RF Loopback", "RF Multi Station"}
  T3 = enum{"RX1/RF 0", "RX2/RF 0", "RX1/RF 1", "RX2/RF 1"}
  T4 = cluster{"f0": f64, "df": f64, "magnitude": f64[]}
  T5 = cluster{"PhyTxStart": bool, "PhyTxEnd": bool, "PhyRxStart": bool, "PhyRxEnd": bool, "MacChannelState": bool, "MacTxStatus": bool, "PhyCcaTiming": bool, "PhyCcaTiming_2": bool, "PhyCcaTiming_3": bool}
  T6 = cluster{"Timestamp": u32, "Transferred Bytes": u32}
  T7 = cluster{"fpga ref": any, "bus instance": u32, "instruction FIFO depth": u32, "executing on FPGA target": bool, "show error call chain": bool}
  T8 = cluster{"Actual Gain [dB]": f64, "Attenuation Table Index": i32}
  T9 = cluster{"Attenuation Table [dB]": f64[][], "Frequencies [Hz]": f64[], "IQ Imbalance Table": "niUsrpRio Config v1 Host.lvlib__IQ Imbalance.gtype"[], "Gain Table": T8[][]}
  "niInstr Register Bus v0 Host.lvlib__Register Bus Session.gtype" = Queue<"niInstr Register Bus v0 Host.lvlib__Session Data.gtype">
  "Semaphore RefNum.gtype" = i32
  "niUsrpRio Config v1 Host.lvlib__DB Queue Reference.gtype" = Queue<"niUsrpRio Config v1 Host.lvlib__Daughterboard Data.gtype">
  "niUsrpRio Config v1 Host.lvlib__niUsrpRio Session.gtype" = cluster{"FPGA Interface": any, "RIO Interface Number": u32, "Data Clock Rate": u32, "FPGA Data Clock Rate": u32, "Global Settings Register Bus": "niInstr Register Bus v0 Host.lvlib__Register Bus Session.gtype", "Radio 0 Settings Register Bus": "niInstr Register Bus v0 Host.lvlib__Register Bus Session.gtype", "Radio 1 Settings Register Bus": "niInstr Register Bus v0 Host.lvlib__Register Bus Session.gtype", "Radio Settings Bus Semaphore": "Semaphore RefNum.gtype", "DB Queues": "niUsrpRio Config v1 Host.lvlib__DB Queue Reference.gtype"[], "Characterization Data Valid?": bool, "EEPROM Header": "niUsrpRio Config v1 Host.lvlib__EEPROM Header.gtype", "Device Data Header": "niUsrpRio Config v1 Host.lvlib__EEPROM Device Data Header.gtype", "EEPROM Characterization Header": "niUsrpRio Config v1 Host.lvlib__EEPROM Characterization Header.gtype", "Characterization Data": "niUsrpRio Config v1 Host.lvlib__Characterization Data.gtype"[], "FPGA Current Version": u32, "FPGA Oldest Compatible Version": u32, "Fixed Logic Current Version": u32, "Fixed Logic Oldest Compatible Version": u32, "FPGA Radio Settings Bus Current Version": u32, "FPGA Radio Settings Bus Oldest Compatible Version": u32, "FPGA Board Config Current Version": u32, "FPGA Board Config Oldest Compatible Version": u32, "Daughterboard Clock Rate": u32}
  T10 = cluster{"Timestamp": u32, "Transferred Bytes": u32, "Flow ID": u8}
  "802.11 Host Session.gtype" = cluster{"FPGA interface": "802.11 FGPA Reference.gtype", "send queue": Queue<u8[]>, "receive queue": Queue<u8[]>, "receive throughput queue": Queue<T6>, "UDP Receiver": UdpNetworkConnectionRefnum, "PN packet": u8[], "FlexRIO session": Queue<T7>, "FlexRIO TX Characterization Data": T9, "FlexRIO RX Characterization Data": T9, "USRP session": "niUsrpRio Config v1 Host.lvlib__niUsrpRio Session.gtype", "RF loop clock frequency": f64, "queue out": Queue<T10>}
  T11 = cluster{"Packet Starts detected": u32, "Frames from PHY": u32, "Frames with FCS pass": u32, "ACKs Received": u32}
  "USRP bandwidth.gtype" = enum{"40 MHz", "120 MHz", "160 MHz"}
  T12 = cluster{"CW": u16, "Last CWs": u16[30], "Last Backoffs": u16[30], "Last Random Numbers": UFXP(0.16)[30]}
  T13 = enum{"Default", "CW Max", "CW Min", "Fixed Backoff Value", "Backoff"}
  T14 = enum{"Default", "Fixed Backoff?", "Enable Piggyback?"}
  "Custom session.gtype" = cluster{"H2T TX Data FIFO: actual depth": u32}
  T15 = cluster{"TX after SIFS requests detected": u32, "TX after SIFS requests completed": u32, "TX after backoff requests detected": u32, "TX after backoff requests completed": u32}
  T16 = cluster{"Frames detected": u32, "Subframes received": u32, "Valid subframes received": u32, "ACKs received": u32}
  T17 = cluster{"PhyTxStart": bool, "PhyTxEnd": bool, "PhyRxStart": bool, "PhyRxEnd": bool, "MacChannelState": bool, "MacTxStatus": bool, "PhyCcaTiming": bool, "PhyRxGainChange": bool, "PhyRxAGCStateChange": bool}
  T18 = cluster{"remove header": bool, "block unsupported frame types": bool, "block FCS errors": bool, "block address mismatch": bool, "block header recognize error": bool}
diagram:
  sequence {
    frame 0 {
      $Events <- EmptyString
      $"Device Ready" <- FALSE
      $"Station Active" <- FALSE
      $Station <- FALSE
      $"RX Constellation" <- c128[] []
      $"RX Power Spectrum" <- T4 {all zero or empty}
      $"TX Power Spectrum" <- T4 {all zero or empty}
      $"Channel Estimation" <- cluster{"Element 1": i32[], "Element 2": f64[]}[] []
      $"MAC TX Statistic" <- T15 {all zero or empty}
      $"MAC RX Statistic" <- T16 {all zero or empty}
      $"Current TX Block Error Rate (BLER)" <- 0
      $"RX Throughput [bits/s]" <- 0
      $"Compensated CFO [Hz]" <- 0
      for (N = 51) {
        $"RX Throughput" <- NaN
        $"TX Block Error Rate" <- NaN
        $"Baseband Power" <- NaN
      }
      Initialize Array(element=NaN, size=51, size=2) -> w1
      $"RF Input Power" <- w1
    }
  }
  call "Create Stop Notifier.gvi"(error in=no error) -> (error out=w2)
  call "802.11 Host Init.gvi"(device=$"RIO Device", error in=w2, reference clock=$"Reference Clock", USRP bandwidth=$"USRP bandwidth") -> (session out=w3, custom session out=w4, error out=w5)
  case (w5) {
    frame Error {
      w6 = w5
    }
    frame No Error {
      $"Device Ready" <- TRUE
      $session <- w3
      $"custom session" <- w4
      w6 = w5
    }
  }
  s1 = w6  # shift register
  while {
    # RX Reception
    call "802.11 Unbundle Session.gvi"(session=$session) -> (FPGA interface=w7, receive queue=w8, receive throughput queue=w9)
    call "802.11 Receive RX ICP.gvi"(FPGA interface=w7, error in=s1, receive queue=w8, receive throughput queue=w9, enqueue decoded data=$"Station Active") -> (error out=w10)
    call "Check Stop.gvi"(error in=w10) -> (error out=w11, stop=w12)
    Wait Until Next Multiple(multiple to wait=0)
    next s1 = w11
    stop if w12
  }
  call "Stop On Error.gvi"(error in=s1) -> (error out=w13)
  s2 = w6  # shift register
  s3 = string[] []  # shift register
  while {
    call "802.11 Unbundle Session.gvi"(session=$session) -> (FPGA interface=w14)
    call "802.11 Prepare Constellation.gvi"(FPGA interface=w14, error in=s2, maximal number of subcarriers=4800) -> (error out=w15, data field constellation=w16, update constellation=w17)
    # update plots and indicators (slow)
    Logical And($"Station Active", w17) -> w18
    case (w18) {
      frame False { }
      frame True {
        $"RX Constellation" <- w16
      }
    }
    call "802.11 Read Event FIFO.gvi"(FPGA interface=w14, error in=s2) -> (raw events=w19, error out=w20)
    call "802.11 Prepare RX Power Spectrum.gvi"(FPGA interface=w14, error in=s2) -> (error out=w21, RX power spectrum=w22, update power spectrum=w23)
    call "802.11 Prepare TX Power Spectrum.gvi"(FPGA interface=w14, error in=s2) -> (error out=w24, TX power spectrum=w25, update power spectrum=w26)
    call "802.11 Prepare Channel Estimation.gvi"(FPGA interface=w14, error in=s2, channel subband=$"Primary Subband", subcarrier format=$"Subcarrier Format") -> (error out=w27, channel estimation=w28, update power spectrum=w29)
    call "802.11 Read Target Registers.gvi"(FPGA interface=w14, error in=s2) -> (error out=w30, target FIFO overflow=w31, compensated CFO=w32, RF input power=w33, MAC RX statistics=w34, MAC TX statistics=w35, signal power at packet start=w36)
    Merge Errors(w15, w21, w24, w27, w30, w20) -> (error out=w37)
    call "Check Stop.gvi"(error in=w37) -> (error out=w38, stop=w39)
    Logical And($"Station Active", w23) -> w40
    case (w40) {
      frame False, Default { }
      frame True {
        $"RX Power Spectrum" <- w22
      }
    }
    Logical And($"Station Active", w26) -> w41
    case (w41) {
      frame False, Default { }
      frame True {
        $"TX Power Spectrum" <- w25
      }
    }
    Logical And($"Station Active", w29) -> w42
    case (w42) {
      frame False, Default { }
      frame True {
        $"Channel Estimation" <- w28
      }
    }
    $"Target FIFO Overflow" <- w31
    $"Compensated CFO [Hz]" <- w32
    $"RF Input Power" <- w33
    $"Baseband Power" <- w36
    $"MAC RX Statistic" <- w34
    $"MAC TX Statistic" <- w35
    call "802.11 Events to String.gvi"(event data=w19, events to track=$"Events to Track") -> (event strings=w43)
    for {
      w44 = each element of w43
      Match Pattern(regular expression="PhyRxStart.ind ", string=w44) -> (offset past match=w46)
      Is Not Equal(x=w46, y=-1) -> w47
      append w47 to w45
    }
    Or Array Elements(Boolean array=w45)
    w48 = -12  # CFX data type offset
    Add(w36, w48) -> w49
    $"Baseband RX Power [dBFS]" <- w49
    Build Array[ConcatenateInputs=True](s3, w43) -> w50
    Delete From Array(inArray=w50, length (1)=10000) -> (deleted=w51)
    Select(s=$"Clear events", t=string[] [], f=w51) -> w52
    Concatenate Strings(w51) -> w53
    $Events <- w53
    Select(s=$None, t=T17 {all zero or empty}, f=$"Events to Track") -> w54
    w55 = T17 {"PhyTxStart"=TRUE, "PhyTxEnd"=TRUE, "PhyRxStart"=TRUE, "PhyRxEnd"=TRUE, "MacChannelState"=TRUE, "MacTxStatus"=TRUE, "PhyCcaTiming"=TRUE, "PhyRxGainChange"=TRUE, "PhyRxAGCStateChange"=TRUE}
    Select(s=$All, t=w55, f=w54) -> w56
    $"Events to Track" <- w56
    Wait Until Next Multiple(multiple to wait=250)
    next s2 = w38
    next s3 = w52
    stop if w39
  }
  call "Stop On Error.gvi"(error in=s2) -> (error out=w57)
  s4 = w6  # shift register
  while {
    Feedback Node(input=$"Station Active") -> w58
    Is Not Equal(x=$"Station Active", y=w58) -> w59
    # update plots and indicators (fast)
    case ($"Station Active") {
      frame False, Default {
        w60 = s4
      }
      frame True {
        call "802.11 Unbundle Session.gvi"(session=$session) -> (FPGA interface=w61, receive throughput queue=w62)
        call "802.11 Prepare Throughput Measurements.gvi"(reset=w59, FPGA interface=w61, receive throughput queue=w62, error in=s4, timing granularity=100) -> (error out=w60, TX block error rate=w63, RX throughput=w64)
        $"Current TX Block Error Rate (BLER)" <- w63
        $"TX Block Error Rate" <- w63
        $"RX Throughput [bits/s]" <- w64
        Divide(x=w64, y=1000000) -> w65
        $"RX Throughput" <- w65
      }
    }
    call "Check Stop.gvi"(error in=w60) -> (error out=w66, stop=w67)
    Wait Until Next Multiple(multiple to wait=100)
    next s4 = w66
    stop if w67
  }
  call "Stop On Error.gvi"(error in=s4) -> (error out=w68)
  while {
    call "Chain Table.gvi"(Address 8=$"Address 1", Address 7=$"Address 2", Address 6=$"Address 3", Address 5=$"Address 4", Address 4=$"Address 5", Address 3=$"Address 6", Address 2=$"Address 7", Address 1=$"Address 8") -> (chain table=w69)
    Feedback Node(input=w70) -> w71
    for (N = w71) {
      Random Number() -> (number (0 to 1)=w73)
      To Fixed Point(number=w73) -> w74: UFXP(0.16) Saturate:ConvergentRounding
      append w74 to w72
    }
    call "802.11 Unbundle Session.gvi"(session=$session) -> (FPGA interface=w75, send queue=w76)
    Type Cast(type=$"WiMAC FPGA Ref", x=w75) -> w77
    Host Fifo Write Node[FifoName="802.11 AFW Resources.grsc\\H2T Random Number FIFO"](data=w72, reference in=w77) -> (empty elements remaining=w70, error out=w78, reference out=w79)
    call "Get Host side total queue length.gvi"(FPGA interface=w75, send queue=w76, custom session=$"custom session", error in=w6, packet size (bytes)=$"packet size plus ICP header (bytes)") -> (Host queue length (packets)=w80, error out=w81, QL of H2T TX Data FIFO (packets)=w82, QL of send queue (packets)=w83)
    To Unsigned Long Integer(number=w80) -> w84
    Property Node(instance in=w79, "CW Max"=$"CW Max", "CW Min"=$"CW Min", "Fixed backoff value"=$"Fixed backoff value", "Fixed backoff?"=$"Fixed backoff?", "Exponential Backoff Ratio"=$"Exponential Backoff Ratio", "time to wait for decoding packet"=$"time to wait for decoding packet", "Backoff: CW Max"=$"Backoff: CW Max", "Backoff: CW Min"=$"Backoff: CW Min", "Backoff: Exponential Backoff Ratio"=$"Backoff: Exponential Backoff Ratio", "Backoff: Fixed Backoff Value"=$"Backoff: Fixed Backoff Value", "Backoff: Fixed Backoff?"=$"Backoff: Fixed Backoff?", "Piggyback: Enable Piggyback"=$"Piggyback: Enable Piggyback", "Piggyback: Piggyback Address"=$"Piggyback: Piggyback Address", "Enable Piggyback"=$"Enable Piggyback", "Use RTR instead of Data?"=$"Use RTR instead of Data?", "Set Backoff Done Pulse to False"=$"Set Backoff Done Pulse to False", "Input: chain table"=w69, "Queue threshold for contention"=$"Queue threshold for contention", "Host queue length (packets)"=w84, "packet size (bytes)"=$"packet size plus ICP header (bytes)", "reset permission to contend"=$"reset permission to contend") -> ("CW and Backoff Indicators"=w85, "data after sifs count"=w86, "count piggyback"=w87, "enable piggyback register"=w88, "Has been transferred?"=w89, "Chain Table"=w90, "ID table"=w91, "Is header?"=w92, "PiggyBack Address"=w93, "Head Mac Address"=w94, "Check if it is matching?"=w95, "Check the ID"=w96, "Order in Chain"=w97, "Index of Max ID"=w98, "Piggy"=w99, "authorized to contend?"=w100, "FPGA queue length"=w101, error out=w102)
    $"CW and Backoff Indicators" <- w85
    $"Host queue length (packets)" <- w80
    $"QL of H2T TX Data FIFO (packets)" <- w82
    $"QL of send queue (packets)" <- w83
    $"data after sifs count" <- w86
    $"count piggyback" <- w87
    $"chain table_2" <- w69
    $"enable piggyback register" <- w88
    $"Has been transferred?" <- w89
    $"chain table" <- w90
    $"chain order" <- w91
    $"Is header?" <- w92
    $"PiggyBack Address" <- w93
    $"Head Mac Address" <- w94
    $"Check if it is matching?" <- w95
    $"Check the ID" <- w96
    $"Order in Chain" <- w97
    $"Index of Max ID" <- w98
    $Piggy <- w99
    $"authorized to contend?" <- w100
    $"FPGA queue length" <- w101
    Merge Errors(w102, w78, w81, w6) -> (error out=w103)
    call "Check Stop.gvi"(error in=w103) -> (error out=w104, stop=w105)
    stop if w105
  }
  call "Stop On Error.gvi"(error in=w104) -> (error out=w106)
  Udp Open(error in=w6, net address=0, port=0, service name="", timeout ms=25000) -> (connection ID=w107, error out=w108)
  call "Set Socket Option.gvi"(connection in=w107, level=0xFFFF, option name=0x1001, value=1024000, error in=w108) -> (error out=w109, connection out=w110)
  s5 = w109  # shift register
  s6 = w110  # shift register
  while {
    # UDP send and receive
    call "802.11 Unbundle Session.gvi"(session=$session) -> (send queue=w111, receive queue=w112, UDP receiver=w113, PN packet=w114)
    case ($"Station Active") {
      frame False, Default {
        w115 = s5
        w116 = s6
      }
      frame True {
        Array Subset(array=w114, length0=$"PN Data Packet Size") -> w117
        case ($"Data Source") {
          frame "UDP" {
            # UDP
            call "802.11 Receive UDP Data.gvi"(UDP receiver=w113, send queue=w111, error in=s5) -> (data transfer=w119, error out=w118, FIFO full=w120)
            $"FIFO Full" <- w120
          }
          frame "PN Data" {
            # PN data
            call "802.11 Send PN Data.gvi"(PN packets per second=$"PN Packets per Second", send queue=w111, PN data=w117, error in=s5) -> (data transfer=w119, error out=w118)
          }
          frame "Manual", Default {
            # Manual
            case ($"Trigger TX") {
              frame False, Default {
                w118 = s5
                w119 = $"Trigger TX"
              }
              frame True {
                Enqueue Element(element=w117, error in=s5, queue=w111, timeout in ms=-1) -> (error out=w118, queue out=w121)
                w119 = $"Trigger TX"
              }
            }
          }
        }
        $"Data Transfer" <- w119
        Is Equal(x=$"Data Sink", y="UDP") -> w122
        call "802.11 Send UDP Data.gvi"(target port=$"Transmit Port", target IP address=$"Transmit IP Address", receive queue=w112, UDP sender=s6, enable=w122, error in=s5) -> (FIFO full=w123, error out=w124, UDP sender dup=w116, data transfer=w125)
        $"Data Transfer" <- w125
        $"FIFO Full" <- w123
        Merge Errors(w118, w124) -> (error out=w115)
      }
    }
    call "Check Stop.gvi"(error in=w115) -> (error out=w126, stop=w127)
    Wait Until Next Multiple(multiple to wait=0)
    next s5 = w126
    next s6 = w116
    stop if w127
  }
  call "Stop On Error.gvi"(error in=s5) -> (error out=w128)
  Udp Close(connection ID=s6, error in=w128) -> (error out=w129)
  s7 = w6  # shift register
  while {
    # TX transmission
    call "802.11 Unbundle Session.gvi"(session=$session) -> (FPGA interface=w130, send queue=w131)
    w132 = $"Station Active"
    while {
      Dequeue Element(error in=s7, queue=w131, timeout in ms=0) -> (element=w133, error out=w134, queue out=w135, timed out?=w136)
      Logical And(w132, not w136) -> w137
      case (w137) {
        frame False {
          w138 = w134
        }
        frame True {
          call "802.11 Subcarrier Format to Configuration.gvi"(MCS=$MCS, subcarrier format=$"Subcarrier Format", error in=w134) -> (error out=w139, format=w140, bandwidth=w141, valid configuration=w142)
          Is Not Equal(x=$"Operation Mode", y="RF Multi Station") -> w143
          Select(s=w143, t=$"Device MAC Address", f=$"Destination MAC Address") -> w144
          Feedback Node(input=w145) -> w146
          case (w142) {
            frame False, Default {
              w147 = FALSE
              w138 = w139
              w145 = w146
            }
            frame True {
              call "802.11 Send TX ICP.gvi"(FPGA interface=w130, MCS=$MCS, device MAC address=$"Device MAC Address", error in=w139, destination MAC address=w144, Flow ID=$"Flow ID", payload=w133, format=w140, bandwidth=w141, send queue=w135) -> (dropped?=w147, error out=w138, DMA FIFO: empty elements remaining=w145)
            }
          }
          $"DMA FIFO: empty elements remaining" <- w145
          $"TX Data Dropped" <- w147
          $"Overwritten by Device MAC Address" <- w143
        }
      }
      call "Check Stop.gvi"(error in=w138) -> (error out=w148, stop=w149)
      Logical Or(w149, w136) -> w150
      stop if w150
    }
    call "Check Stop.gvi"(error in=w148) -> (error out=w151, stop=w152)
    Wait Until Next Multiple(multiple to wait=0)
    next s7 = w151
    stop if w152
  }
  call "Stop On Error.gvi"(error in=s7) -> (error out=w153)
  s8 = w6  # shift register
  while {
    # configuration
    call "802.11 Unbundle Session.gvi"(session=$session) -> (FPGA interface=w154)
    Feedback Node(input=$"Station Active") -> w155
    case ($"Station Active") {
      frame False, Default {
        w156 = s8
      }
      frame True {
        Is Not Equal(x=$"Station Active", y=w155) -> w157
        call "802.11 Gain Control.gvi"(initialize=w157, RX Port (USRP only)=$"RX Port (USRP only)", session=$session, AGC=$AGC, error in=s8, Manual RX gain [dB]=$"Manual RX gain [dB]", RX Frequency [Hz]=$"RX Frequency [Hz]", TX Port (USRP only)=$"TX Port (USRP only)") -> (Applied RX Gain [dB]=w158, error out=w159)
        $"Applied RX Gain [dB]" <- w158
        call "802.11 Subcarrier Format to Configuration.gvi"(MCS=$MCS, subcarrier format=$"Subcarrier Format", error in=s8) -> (error out=w160, format=w161)
        call "802.11 Configure Dynamic Parameters.gvi"(FPGA interface=w154, error in=w160, format=w161, transmit ACK=$"Transmit ACK", CCA energy detection threshold=$"CCA Energy Detection Threshold [dBm]") -> (error out=w162)
        Merge Errors(w159, w162) -> (error out=w156)
      }
    }
    w163 = $Station
    Feedback Node(input=w163) -> w164
    Logical Exclusive Or(w163, w164) -> w165
    case (w165) {
      frame False, Default {
        w166 = s8
      }
      frame True {
        case (w163) {
          frame False, Default {
            sequence {
              frame 0 {
                $"Station Active" <- w163
              }
            }
            call "802.11 Unbundle Session.gvi"(session=$session) -> (UDP receiver=w167)
            Udp Close(connection ID=w167, error in=s8) -> (error out=w168)
            call "Clear Errors.gvi"(specific error code to clear=1, error in=w168) -> (error out=w169)
            call "802.11 Abort RF Streams.gvi"(session=$session, error in=w169) -> (error out=w166)
          }
          frame True {
            $"RX Frequency [Hz]" <- $"TX Frequency [Hz]"
            call "802.11 FPGA Target Configuration.gvi"() -> (maximum gain=w170, enable DC offset correction=w171)
            w172 = T18 {"remove header"=TRUE, "block unsupported frame types"=TRUE, "block FCS errors"=TRUE, "block address mismatch"=TRUE, "block header recognize error"=TRUE}
            call "802.11 Configure Static Parameters.gvi"(session in=$session, error in=s8, primary subband=$"Primary Subband", operation mode=$"Operation Mode", enable DC offset correction=w171, MPDU filter configuration=w172, device MAC address=$"Device MAC Address") -> (session dup=w173, error out=w174)
            call "802.11 Reset Statistics.gvi"(session in=w173, error in=w174, reset RX statistics=TRUE, reset TX statistics=TRUE) -> (error out=w175, session dup=w176)
            call "802.11 Configure TX RF.gvi"(TX port=$"TX Port (USRP only)", session=w176, TX frequency=$"TX Frequency [Hz]", TX power level=$"Power Level [dBm]", error in=w175) -> (session dup=w177, error out=w178, coerced TX power level=w179, coerced LO frequency=w180)
            call "802.11 Configure RX RF.gvi"(RX frequency=$"TX Frequency [Hz]", session=w177, RX gain=w170, error in=w178, RX port=$"RX Port (USRP only)") -> (error out=w181, session dup=w182, coerced RX gain=w183, coerced LO frequency=w184)
            call "802.11 Configure AGC Registers.gvi"(TX Port=$"TX Port (USRP only)", enable AGC=FALSE, session=w182, RX port=$"RX Port (USRP only)", error in=w181) -> (error out=w185, session dup=w186)
            call "802.11 Set Power Calibration Offset.gvi"(session=w186, frequency=$"TX Frequency [Hz]", error in=w185, RX port=$"RX Port (USRP only)") -> (session dup=w187, error out=w188)
            call "802.11 Configure RF Streams.gvi"(TX port=$"TX Port (USRP only)", RX port=$"RX Port (USRP only)", session=w187, error in=w188) -> (session dup=w189, error out=w190)
            call "802.11 Configure Data Source.gvi"(error in=w190, receive port=$"Receive Port", session in=w189) -> (error out=w166, session out=w191, success?=w192)
            $session <- w191
            sequence {
              frame 0 {
                $Station <- w192
                $"Station Active" <- w163
              }
            }
            $"Coerced LO frequency RX [Hz]" <- w184
            $"Applied RX Gain [dB]" <- w183
            $"Coerced LO frequency TX [Hz]" <- w180
            $"Coerced Power Level [dBm]" <- w179
          }
        }
      }
    }
    call "802.11 Reset Statistics.gvi"(session in=$session, error in=s8, reset RX statistics=$"reset RX staistics", reset TX statistics=$"reset TX staistics") -> (error out=w193)
    call "802.11 Subcarrier Format to Configuration.gvi"(MCS=$MCS, subcarrier format=$"Subcarrier Format", error in=w193) -> (modulation and coding rate=w194, error out=w195)
    Merge Errors(w156, w166, w195) -> (error out=w196)
    call "Create Stop.gvi"(error in=w196, stop in=$Stop) -> (error out=w197)
    call "Check Stop.gvi"(error in=w197) -> (error out=w198, stop=w199)
    Wait Until Next Multiple(multiple to wait=100)
    $"modulation and coding rate" <- w194
    next s8 = w198
    stop if w199
  }
  call "Stop On Error.gvi"(error in=s8) -> (error out=w200)
  Merge Errors(w200, w153, w13, w129, w57, w68, w106) -> (error out=w201)
  sequence {
    frame 0 {
      w202 = $session
    }
  }
  call "802.11 Host Release.gvi"(session=w202, error in=w201) -> (error out=w203)
  call "Simple Error Handler.gvi"(type of dialog="OK message", error in=w203)
