vi "802.11 FPGA STA.gvi"   [LabVIEW Communications System Design Suite 2.0.1]
panel controls:
  "reg.host read.go rcvd 0": bool
  "reg.notify host.go rcvd 0": bool
  "reg.reset 0": bool
  "RF 0/Rx/Enable": bool
  "RF 0/Tx/Enable": bool
  "RF 1/Rx/Enable": bool
  "RF 1/Tx/Enable": bool
  "ATR State": enum{"Idle", "Rx", "Tx", "Duplex"} = "Idle"
  "Radio Control Destination": T1 = "Radio 0 Config"
  "lo lpf enable": bool
  "power enable": bool
  "mixer enable": bool
  "tx.configuration": T2 = {"power enable"=TRUE, "mixer enable"=TRUE, "gain"=0}
  "RX data source": T3 = "RF"
  "packet start sample index": u16
  "rearm packet start generator": bool
  "bypass synchronization": bool
  "reset MAC RX statistics": bool
  "noise coefficient": FXP(8.8) = 10
  "mute RX while TX active?": bool = TRUE
  "number of samples to capture": u16 = 1024
  "produce silent samples": bool
  "MPDU filter config": T7 = {"remove header"=TRUE, "block unsupported frame types"=TRUE, "block FCS errors"=TRUE, "block address mismatch"=TRUE, "block header recognize error"=TRUE}
  "power calibration offset": FXP(10.3)
  "CCA energy detect threshold": FXP(10.3) = -62
  "RF gain": FXP(10.3)
  "number of samples before trigger": u16
  "synchronization settings": T8 = {"maximal normalization threshold"=65536, "peak timing metric threshold"=0.5, "consecutive samples over threshold"=10, "valley timing metric threshold"=-0.5, "consecutive samples under threshold"=10, "autocorelation threshold"=0.5, "expected peak valley distance"=608, "maximum peak valley distance deviation"=64, "samples to shift frame start"=-32, "use static CFO?"=FALSE, "static CFO"=0}
  "trigger condition": T9 = "Immediate"
  "manual trigger": bool
  "AGC tresholds": T10
  "AGC timeout": i32 = 3500
  "enable AGC": bool
  "manual PhyTxStart.req": cluster{"TX vector": T11, "Valid": bool}
  "bypass MAC TX": bool
  "RX TX turnaround time": u32 = 24
  "reset MAC TX statistics": bool
  "suppress ACK": bool
  "ACK bandwidth": enum{"20 MHz", "40 MHz", "80 MHz"} = "20 MHz"
  "rx.reset": bool = TRUE
  "rx.output sample rate": UFXP(1.47)
  "rx.delay": FXP(0.16)
  "rx 0.frequency shift": FXP(0.48)
  "rx 0.phase": FXP(0.21)
  "rx 0.impairments": T13 = {"inline gain I"=-1, "inline gain Q"=0.999992370605, "cross gain I"=0.999992370605, "cross gain Q"=0, "pre-gain offset I"=0, "pre-gain offset Q"=-1, "post-gain offset I"=0, "post-gain offset Q"=0.999992370605}
  "rx.abort": bool
  "tx.abort": bool
  "tx.reset": bool = TRUE
  "tx.input sample rate": UFXP(1.47)
  "tx.delay": FXP(0.18)
  "tx 0.frequency shift": FXP(0.48)
  "tx 0.phase": FXP(0.21)
  "tx 0.impairments": T13 = {"inline gain I"=0.999992370605, "inline gain Q"=0.999992370605, "post-gain offset I"=0.999992370605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}
  "tx 0.gain": T14 = {"gain I"=1, "gain Q"=1}
  "rx 1.impairments": T13 = {"inline gain I"=-0.999992370605, "inline gain Q"=0.999992370605, "cross gain I"=-0.999992370605, "cross gain Q"=0, "pre-gain offset I"=-1, "pre-gain offset Q"=0, "post-gain offset I"=0, "post-gain offset Q"=0}
  "rx 1.frequency shift": FXP(0.48)
  "rx 1.phase": FXP(0.21)
  "tx 1.impairments": T13 = {"inline gain I"=0.999992370605, "inline gain Q"=0.999992370605, "post-gain offset I"=-1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}
  "tx 1.frequency shift": FXP(0.48)
  "tx 1.phase": FXP(0.21)
  "tx 1.gain": T14 = {"gain I"=1, "gain Q"=1}
  "rx 0.stream enable": bool
  "rx 1.stream enable": bool
  "tx 0.stream enable": bool
  "tx 1.stream enable": bool
  "Data clock cycles per tick (0.1us)": u16 = 20
  "Data clock cycles per OFDM symbol": u16 = 480
  "rx.rf channel": UFXP(1.0)
  "tx.rf channel": UFXP(1.0)
  "enable DC offset correction": bool = TRUE
  "data clock locked?": bool
  "format": enum{"a", "ac"} = "a"
  "channel selector": UFXP(2.0)
  "device MAC address": u8[6]
  "DC centered signal": bool = TRUE
  "daughterboard": "niUsrpRio Config v1 Host.lvlib__DB Types.gtype" = "sbx"
  "antenna configuration": "niUsrpRio Config v1 Host.lvlib__Antenna Configuration.gtype" = "TX1 RX1 transmits and RX2 receives"
  "spi address": u8 = 7
  "cpld enable": bool = TRUE
  "time to wait for decoding packet": u32
  "CW Max": u16
  "CW Min": u16
  "Fixed backoff?": bool
  "Exponential Backoff Ratio": UFXP(6.10)
  "Fixed backoff value": u16
  "Backoff: Fixed Backoff Value": "U16 Register Names Enum.gtype" = "CW Max"
  "Backoff: CW Max": "U16 Register Names Enum.gtype" = "CW Max"
  "Backoff: Exponential Backoff Ratio": "FXP 6.10 Register Names Enum.gtype" = "Default"
  "Backoff: CW Min": "U16 Register Names Enum.gtype" = "CW Max"
  "Backoff: Fixed Backoff?": "Boolean Register Names Enum.gtype" = "Default"
  "Set Backoff Done Pulse to False": bool
  "Piggyback: Piggyback Address": "MAC Address Register Names.gtype" = "Default"
  "Piggyback: Enable Piggyback": "Boolean Register Names Enum.gtype" = "Default"
  "Enable Piggyback": bool
  "Use RTR instead of Data?": bool
  "Input: chain table": u64[8]
  "Host queue length (packets)": u32
  "Queue threshold for contention": u32
  "packet size (bytes)": u32
  "reset permission to contend": bool
  "Qchain:DIFS after ACK done (manual)": bool
  "Qchain:Use manual for DIFS after ACK done?": bool
  "Qchain:DIFS in global clock ticks": u32 = 340
panel indicators:
  "reg.notify host.go 0": bool
  "reg.host read.data 0": cluster{"go": bool, "data": u32}
  "compensated CFO": FXP(0.48)
  "MAC RX statistics": T4
  "PhyRxStart.ind": T5
  "PhyRxEnd.ind": T6
  "T2H RX Data overflow": u16
  "T2H Constallation overflow": u16
  "T2H RX Bit Processing Output FIFO overflow": u16
  "T2H RX Power Spectrum overflow": u16
  "T2H Channel Estimation overflow": u16
  "last applied gain": UFXP(5.1)
  "RF input power at packet start": FXP(10.3)
  "signal power at packet start": FXP(10.3)
  "RF input power": FXP(10.3)
  "signal power": FXP(10.3)
  "out of range?": bool
  "MAC TX statistics": T12
  "PhyTxStart.req": cluster{"TX vector": T11, "Valid": bool}
  "PhyTxEnd.ind": cluster{"Valid": bool}
  "internal loopback FIFO overflow": u16
  "TX to RF FIFO overflow": u16
  "T2H TX Baseband FIFO overflow": u16
  "T2H TX Bit Processing Output FIFO overflow": u16
  "rx.samples processed": u32
  "rx.number of IQ data overflows": u64
  "rx.number of overflows": u32
  "tx.samples processed": u32
  "tx.underflows": u32
  "tx.number of IQ data overflows": u64
  "rx.dsp reset done": bool
  "tx.dsp reset done": bool
  "tx.state": "Stream Control State.gtype"
  "rx.state": "Stream Control State.gtype"
  "Timestamp": u32
  "DC average": CFXP(1.17)
  "CW and Backoff Indicators": T15
  "Qchain:data after sifs count": u32
  "enable piggyback register": u32
  "count piggyback": u32
  "Has been transferred?": bool
  "ID table": u8[8]
  "Chain Table": u64[8]
  "Is header?": bool
  "Order in Chain": u8
  "Head Mac Address": u8[6]
  "PiggyBack Address": u8[6]
  "Check if it is matching?": bool
  "Check the ID": u8
  "Index of Max ID": i32
  "Piggy": u64
  "authorized to contend?": bool
  "FPGA queue length": u32
  "Qchain:count DIFS after ACK done": u32
  "Qchain:count TX after backoff done": u32
  "Qchain:count CCA idle for DIFS time": u32
  "Qchain:DIFS count": u32
types:
  T1 = enum{"Identification", "Board Config", "Global Config", "Radio 0 Config", "Radio 1 Config", "Synchronization", "Time", "Future Events"}
  T2 = cluster{"power enable": bool, "mixer enable": bool, "gain": u8}
  T3 = enum{"RF", "BB Data From Host", "Internal Loopback"}
  T4 = cluster{"number of frames detected": u32, "number of subframes received": u32, "number of valid subframes received": u32, "number of ACKs received": u32, "valid": bool}
  T5 = cluster{"Format": enum{"a", "ac"}, "Bandwidth": enum{"20 MHz", "40 MHz", "80 MHz"}, "PSDU Length": u32, "MCS": UFXP(4.0), "valid": bool}
  T6 = cluster{"Format Violation": bool, "Timing valid": bool, "Timing value": u32, "valid": bool}
  T7 = cluster{"remove header": bool, "block unsupported frame types": bool, "block FCS errors": bool, "block address mismatch": bool, "block header recognize error": bool}
  T8 = cluster{"maximal normalization threshold": UFXP(19.15), "peak timing metric threshold": FXP(2.6), "consecutive samples over threshold": u8, "valley timing metric threshold": FXP(2.6), "consecutive samples under threshold": u8, "autocorelation threshold": UFXP(2.14), "expected peak valley distance": u16, "maximum peak valley distance deviation": u8, "samples to shift frame start": i8, "use static CFO?": bool, "static CFO": FXP(0.48)}
  T9 = enum{"Immediate", "RX Packet Start", "TX Paket Start", "CCA energy detected"}
  T10 = cluster{"AGC active threshold": FXP(10.3), "AGC threshold 1": FXP(10.3), "AGC threshold 2": FXP(10.3), "AGC threshold 3": FXP(10.3)}
  T11 = cluster{"format": enum{"a", "ac"}, "bandwidth": enum{"20 MHz", "40 MHz", "80 MHz"}, "length": u32, "MCS": UFXP(4.0), "TX power level": UFXP(4.0), "Scrambler seed": UFXP(7.0)}
  T12 = cluster{"number of TX after SIFS requests detected": u32, "number of TX after SIFS requests completed": u32, "number of TX after backoff requests detected": u32, "number of TX after backoff requests completed": u32}
  T13 = cluster{"inline gain I": FXP(1.17), "inline gain Q": FXP(1.17), "cross gain I": FXP(1.17), "cross gain Q": FXP(1.17), "pre-gain offset I": FXP(1.17), "pre-gain offset Q": FXP(1.17), "post-gain offset I": FXP(1.17), "post-gain offset Q": FXP(1.17)}
  T14 = cluster{"gain I": FXP(3.21), "gain Q": FXP(3.21)}
  "Stream Control State.gtype" = enum{"Idle", "Active"}
  "niUsrpRio Config v1 Host.lvlib__DB Types.gtype" = enum{"sbx", "cbx", "wbx", "unknown", "ubx"}
  "niUsrpRio Config v1 Host.lvlib__Antenna Configuration.gtype" = enum{"TX1 RX1 transmits and RX2 receives", "TX1 RX1 receives and RX2 is unused"}
  T15 = cluster{"CW": u16, "Last CWs": u16[30], "Last Backoffs": u16[30], "Last Random Numbers": UFXP(0.16)[30]}
  "U16 Register Names Enum.gtype" = enum{"Default", "CW Max", "CW Min", "Fixed Backoff Value", "Backoff"}
  "FXP 6.10 Register Names Enum.gtype" = enum{"Default", "Exponential Backoff Ratio"}
  "Boolean Register Names Enum.gtype" = enum{"Default", "Fixed Backoff?", "Enable Piggyback?"}
  "MAC Address Register Names.gtype" = enum{"Default", "Piggyback MAC Address"}
  "Cluster Constant.gtype" = cluster{"CW Max Reg": RegisterDataType<u16>, "CW Min Reg": RegisterDataType<u16>, "Fixed Backoff Value Reg": RegisterDataType<u16>, "Backoff": RegisterDataType<u16>, "Exponential Backoff Ratio Reg": RegisterDataType<UFXP(6.10)>, "Fixed Backoff Reg": RegisterDataType<bool>, "U16 Default": RegisterDataType<u16>, "FXP <6.10> Default": RegisterDataType<UFXP(6.10)>, "Boolean Default": RegisterDataType<bool>, "Has been transferred?": RegisterDataType<bool>, "If is the header?": RegisterDataType<bool>}
  T16 = cluster{"MPDU subtype": enum{"ACK"}, "destination MAC address": u8[6], "valid": bool}
  T17 = cluster{"CCA energy detection busy": u8, "CCA signal detection busy": bool, "frame timing valid": bool, "frame timing value": u32, "frame timing use DIFS": bool}
  T18 = cluster{"5 MHz": bool, "10 MHz": bool, "20 MHz": bool, "40 MHz": bool, "80 Mhz": bool, "160 MHz": bool}
  T19 = cluster{"format": enum{"a", "ac"}, "channel selector": UFXP(2.0), "device MAC address": u8[6], "DC centered signal": bool, "supported bandwidths": T18}
  T20 = cluster{"global timestamp": RegisterDataType<u32>, "OFDM symbol pulse": RegisterDataType<bool>, "TX active": RegisterDataType<bool>, "channel state indication": RegisterDataType<T17>, "MPDU generation request": RegisterDataType<T16>, "shared properties": RegisterDataType<T19>}
  T21 = cluster{"CCA energy detection busy": u8, "CCA signal detection busy": bool}
  T22 = enum{"Idle", "Wait for second measurement", "AGC active", "Gain locked"}
  T23 = cluster{"trigger gain setting": bool, "gain": UFXP(5.1)}
  "802.11 PHY-SAP.gtype" = cluster{"PSDU (RX)": any, "PSDU (TX)": any, "CCA detection": RegisterDataType<T21>, "PhyRxStart.req": HandshakeDataType<T5>, "PhyRxEnd.ind": HandshakeDataType<T6>, "channel state indication": HandshakeDataType<T17>, "PhyTxStart.req": HandshakeDataType<cluster{"TX vector": T11, "Valid": bool}>, "PhyTxEnd.ind": HandshakeDataType<cluster{"Valid": bool}>, "PHY RX AGC state indication": HandshakeDataType<cluster{"AGC state": T22, "AGC enabled": bool}>, "PHY RX Gain change indication": HandshakeDataType<T23>}
  T24 = cluster{"RF to RX FIFO": any, "internal loopback FIFO": any, "TX to RF FIFO": any, "Gain Settings FIFO": any}
  T25 = cluster{"output sample rate": UFXP(1.47), "delay": FXP(0.16), "frequency shift": FXP(0.48), "impairments": T13, "phase": FXP(0.21)}
  T26 = cluster{"frequency shift": FXP(0.48), "impairments": T13, "phase": FXP(0.21), "input sample rate": UFXP(1.47), "gain": T14, "delay": FXP(0.18)}
diagram:
  Register Create(initial value=1024) -> (reference out=w1)
  Register Create(initial value=8) -> (reference out=w2)
  Register Create(initial value=4) -> (reference out=w3)
  Register Create(initial value=0) -> (reference out=w4)
  Register Create(initial value=0) -> (reference out=w5)
  Register Create(initial value=FALSE) -> (reference out=w6)
  Register Create(initial value=0) -> (reference out=w7)
  Register Create(initial value=0) -> (reference out=w8)
  Register Create(initial value=FALSE) -> (reference out=w9)
  Register Create(initial value=FALSE) -> (reference out=w10)
  Register Create(initial value=FALSE) -> (reference out=w11)
  Property Node(instance in="Cluster Constant.gtype" {all zero or empty}, "CW Max Reg"=w1, "CW Min Reg"=w2, "Fixed Backoff Value Reg"=w3, "Backoff"=w4, "Exponential Backoff Ratio Reg"=w5, "Fixed Backoff Reg"=w6, "U16 Default"=w7, "FXP <6.10> Default"=w8, "Boolean Default"=w9, "Has been transferred?"=w10, "If is the header?"=w11) -> (instance out=w12)
  Register Create(initial value=0) -> (reference out=w13)
  Register Create(initial value=FALSE) -> (reference out=w14)
  w15 = T16 {"MPDU subtype"="ACK", "destination MAC address"=[0, 0, 0, 0, 0, 0], "valid"=FALSE}
  Register Create(initial value=w15) -> (reference out=w16)
  Register Create(initial value=FALSE) -> (reference out=w17)
  Register Create(initial value=T17 {all zero or empty}) -> (reference out=w18)
  w19 = T19 {"format"="a", "channel selector"=0, "device MAC address"=[0, 0, 0, 0, 0, 0], "DC centered signal"=FALSE, "supported bandwidths"={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}}
  Register Create(initial value=w19) -> (reference out=w20)
  Property Node(instance in=T20 {all zero or empty}, "global timestamp"=w13, "MPDU generation request"=w16, "channel state indication"=w18, "TX active"=w17, "OFDM symbol pulse"=w14, "shared properties"=w20) -> (instance out=w21)
  FIFO Create(data type=u8 0) -> (reference out=w22)
  FIFO Create(data type=u8 0) -> (reference out=w23)
  Register Create(initial value=T21 {all zero or empty}) -> (reference out=w24)
  Handshake Create(data type=T5 {all zero or empty}) -> (reference out=w25)
  Handshake Create(data type=T6 {all zero or empty}) -> (reference out=w26)
  Handshake Create(data type=T17 {all zero or empty}) -> (reference out=w27)
  Handshake Create(data type=cluster{"TX vector": T11, "Valid": bool} {all zero or empty}) -> (reference out=w28)
  Handshake Create(data type=cluster{"Valid": bool} {all zero or empty}) -> (reference out=w29)
  w30 = cluster{"AGC state": T22, "AGC enabled": bool} {all zero or empty}
  Handshake Create(data type=w30) -> (reference out=w31)
  Handshake Create(data type=T23 {all zero or empty}) -> (reference out=w32)
  Property Node(instance in="802.11 PHY-SAP.gtype" {all zero or empty}, "PSDU (RX)"=w22, "PSDU (TX)"=w23, "CCA detection"=w24, "PhyRxStart.req"=w25, "PhyRxEnd.ind"=w26, "channel state indication"=w27, "PhyTxStart.req"=w28, "PhyTxEnd.ind"=w29, "PHY RX AGC state indication"=w31, "PHY RX Gain change indication"=w32) -> (instance out=w33)
  clock-driven loop (clock = "802.11 AFW Resources.grsc\\MACSLOW") (after w12) forever {
    call "802.11 PHY-SAP Read MAC.gcdl"(PHY-SAP=w33) -> (CCA detection=w34, PSDU=w35, PSDU valid=w36, PhyRxStart.req=w37, PhyTxEnd.ind=w38, PhyRxEnd.ind=w39, PHY RX AGC state indication=w40, PHY RX Gain change indication=w41)
    Property Node(instance in=w21) -> ("shared properties"=w42, "global timestamp"=w43, "channel state indication"=w44)
    Register Read(reference in=w43) -> (data=w45)
    call "Piggyback.gcdl"(Piggyback: Piggyback Address=$"Piggyback: Piggyback Address", Piggyback: Enable Piggyback=$"Piggyback: Enable Piggyback") -> (Piggyback Address=w46, Piggyback Enable?=w47)
    Property Node(instance in=w37) -> ("valid"=w48)
    Feedback Node(enable?=w48, initial value=u8[6] default, input=w49) -> w50
    Feedback Node(input=w51) -> w52
    call "802.11 MAC RX.gcdl"(PSDU=w35, input valid=w36, PHY RX start indication=w37, PHY RX end indication=w39, PHY CCA timing indication=w34, reset MAC RX statistics=$"reset MAC RX statistics", device MAC address=w50, MPDU filter config=$"MPDU filter config", Enable Piggyback=w47, piggyback MAC address=w46, Qchain:DIFS after ACK done=w52, global clock counter=w45, Input: chain table=$"Input: chain table") -> (MAC RX statistics=w53, channel state indication=w54, ICP SDU=w55, output valid=w56, MPDU generation request=w57, ACK Received Pulse=w58, Piggyback?=w59, Qchain:count DIFS after ACK done=w60)
    $"Qchain:count DIFS after ACK done" <- w60
    call "802.11 RX Data Sink.gcdl"(ICP SDU=w55, input valid=w56, FIFO reference="802.11 AFW Resources.grsc\\T2H RX Data") -> (FIFO overflow count=w61)
    $"T2H RX Data overflow" <- w61
    # w57: MPDU request
    Register Write(data=w54, reference in=w44) -> (reference out=w62)
    # w45: global time reference
    Register Read(reference in=w62) -> (data=w63)
    Register Read(reference in=w42) -> (data=w64)
    # w33: PHY SAP
    Property Node(instance in=w64) -> ("format"=w65, "device MAC address"=w49)
    # w62: channel state indication
    Feedback Node(input=w66) -> w67
    # w68: TX Data after SIFS
    call "802.11 Prepare ACK.gcdl"(format=w65, bandwidth=$"ACK bandwidth", MPDU generation request=w57, MAC ready=w67, suppress=$"suppress ACK") -> (MPDU block=w69, output valid=w70, TX after SIFS request=w71, TX Data After SIFS=w68)
    Register Read(reference in="802.11 AFW Resources.grsc\\Backoff") -> (data=w72)
    Property Node(instance in="802.11 AFW Resources.grsc\\H2T TX Data") -> ("used elements"=w73)
    call "manage permission to contend.gcdl"(Host queue length (packets)=$"Host queue length (packets)", FPGA queue length (bytes)=w73, Queue threshold for contention (packets)=$"Queue threshold for contention", packet size (bytes)=$"packet size (bytes)", reset permission to contend=$"reset permission to contend") -> (authorized to contend?=w74)
    Feedback Node(input=w75) -> w76
    call "802.11 TX Data Source.gcdl"(ready for output=w76, H2T TX Data="802.11 AFW Resources.grsc\\H2T TX Data", bypass MAC TX=$"bypass MAC TX") -> (ICP data=w77, output valid=w78, elements available=w79)
    Feedback Node(input=w80) -> w81
    Feedback Node(input=w82) -> w83
    call "802.11 Prepare MPDU.gcdl"(ICP=w77, input valid=w78, elements available=w79, MAC ready for input=w81, TX status indication=w83, backoff value=w72, Use RTR instead of Data?=$"Use RTR instead of Data?", authorized to contend?=w74) -> (MPDU block=w84, ready for input=w75, output valid=w85, TX after backoff request=w86)
    Logical Or(w69, w84) -> w87
    Logical Or(w70, w85) -> w88
    Feedback Node(input=w89) -> w90
    call "802.11 MAC TX.gcdl"(TX after backoff request=w86, TX after SIFS request=w71, channel state indication=w63, global clock value=w45, RX TX turnaround time in global clock ticks=$"RX TX turnaround time", PSDU data ready for input=w90, PHY TX end indication=w38, MPDU block=w87, input valid=w88, reset MAC TX statistics=$"reset MAC TX statistics", Set Backoff Done Pulse to False=$"Set Backoff Done Pulse to False", TX Data After SIFS=w68) -> (MPDU=w91, output valid=w92, PHY TX start request=w93, TX after SIFS data ready for input=w66, TX after backoff data ready for input=w80, TX status indication=w82, MAC TX statistics=w94, TX after backoff done=w95, Qchain:data after sifs count=w96, Qchain:count TX after backoff done=w97, Qchain:DIFS done pulse=w98, Qchain:DIFS count=w99)
    call "802.11 TX MAC Bypass.gcdl"(ready for output=w90, TX data FIFO reference="802.11 AFW Resources.grsc\\H2T TX Data", bypass MAC TX=$"bypass MAC TX", manual PhyTxStart.req=$"manual PhyTxStart.req", MPDU=w91, input valid=w92, request in=w93) -> (PSDU=w100, output valid=w101, request out=w102)
    call "802.11 PHY-SAP Write MAC.gcdl"(PHY-SAP=w33, PhyTxStart.req=w102, PSDU=w100, PSDU valid=w101, channel state indication=w54) -> (PSDU TX ready for input=w89)
    $"MAC RX statistics" <- w53
    Feedback Node(input=w95) -> w103
    call "Check ACK Received.gcdl"(ACK Received Pulse In=w58, TX after backoff done=w103, time to wait for decoding packet=$"time to wait for decoding packet", global clock counter=w45) -> (ACK Received out=w104, valid?=w105)
    FIFO Write(Control Protocol Input=w105, data=w104, reference in="802.11 AFW Resources.grsc\\ACK Received FIFO")
    call "niInstr Basic Elements v1 FPGA.lvlib__Count Up U32.gcdl"(increment=w59) -> (count out=w106)
    $"count piggyback" <- w106
    $"MAC TX statistics" <- w94
    $"Qchain:DIFS count" <- w99
    $"Qchain:data after sifs count" <- w96
    $"Qchain:count TX after backoff done" <- w97
    $"FPGA queue length" <- w73
    call "niInstr Basic Elements v1 FPGA.lvlib__Count Up U32.gcdl"(increment=w47) -> (count out=w107)
    # w37: PHY RX start indication
    # w39: PHY RX end indication
    # w34: CCA detection
    # w41: PHY RX Gain change indication
    $"enable piggyback register" <- w107
    # w40: PHY RX AGC state indication
    call "802.11 Write RX Events.gcdl"(global timestamp=w45, PHY RX start indication=w37, PHY RX end indication=w39, MAC channel state indication=w54, PHY CCA timing indication=w34, T2H FIFO reference="802.11 AFW Resources.grsc\\T2H Events", PHY RX Gain change indication=w41, PHY RX AGC state indication=w40)
    call "802.11 Capture PHY TX Indications.gcdl"(PHY TX end indication in=w38, PHY TX start request in=w102) -> (PHY TX start request out=w108, PHY TX end indication out=w109)
    $"PhyTxStart.req" <- w108
    $"authorized to contend?" <- w74
    $"PhyTxEnd.ind" <- w109
    call "802.11 Write TX Events.gcdl"(global time reference=w45, PHY TX end indication=w38, PHY TX start request=w102, TX status indication=w82, T2H FIFO reference="802.11 AFW Resources.grsc\\T2H Events")
    # w38: PhyTxEnd.ind
    call "Reset to next Chain.gcdl"(TX after backoff done=w103, slot M2 end pulse=w98, Use manual for DIFS after ACK done?=$"Qchain:Use manual for DIFS after ACK done?", global clock counter=w45, DIFS after ACK done (manual)=$"Qchain:DIFS after ACK done (manual)", Qchain:DIFS in global clock ticks=$"Qchain:DIFS in global clock ticks") -> (DIFS after ACK done=w51, count CCA idle for DIFS time=w110)
    $"Qchain:count CCA idle for DIFS time" <- w110
    call "Backoff Block.gcdl"(Backoff: CW Max=$"Backoff: CW Max", Backoff: Exponential Backoff Ratio=$"Backoff: Exponential Backoff Ratio", Backoff: CW Min=$"Backoff: CW Min", Backoff: Fixed Backoff Value=$"Backoff: Fixed Backoff Value", Backoff: Fixed Backoff?=$"Backoff: Fixed Backoff?") -> (CW and Backoff Indicators=w111)
    $"CW and Backoff Indicators" <- w111
    Register Read(reference in="802.11 AFW Resources.grsc\\Has been transferred?") -> (data=w112)
    $"Has been transferred?" <- w112
    Register Read(reference in="802.11 AFW Resources.grsc\\Piggy") -> (data=w113)
    $Piggy <- w113
    # w98: DIFS done pulse
    Register Read(reference in="802.11 AFW Resources.grsc\\Head Mac Address") -> (data=w114)
    $"Head Mac Address" <- w114
    Register Read(reference in="802.11 AFW Resources.grsc\\ID Table") -> (data=w115)
    $"ID table" <- w115
    Register Write(data=$"Input: chain table", reference in="802.11 AFW Resources.grsc\\Chain Table")
    Register Write(data=$"Fixed backoff?", reference in="802.11 AFW Resources.grsc\\Fixed Backoff?")
    Register Write(data=$"CW Max", reference in="802.11 AFW Resources.grsc\\CW Max")
    Register Write(data=$"Exponential Backoff Ratio", reference in="802.11 AFW Resources.grsc\\Exponential Backoff Ratio")
    Register Read(reference in="802.11 AFW Resources.grsc\\Piggyback Address") -> (data=w116)
    $"PiggyBack Address" <- w116
    Register Write(data=$"CW Min", reference in="802.11 AFW Resources.grsc\\CW Min")
    Register Read(reference in="802.11 AFW Resources.grsc\\Chain Table") -> (data=w117)
    $"Chain Table" <- w117
    Register Write(data=$"Enable Piggyback", reference in="802.11 AFW Resources.grsc\\Enable Piggyback?")
    Register Write(data=$"Fixed backoff value", reference in="802.11 AFW Resources.grsc\\Fixed Backoff Value")
    Register Read(reference in="802.11 AFW Resources.grsc\\Check if it is matching?") -> (data=w118)
    $"Check if it is matching?" <- w118
    Register Read(reference in="802.11 AFW Resources.grsc\\Order ID in chain") -> (data=w119)
    $"Order in Chain" <- w119
    call "check if is the header.gcdl"(Order in the Chain=w119) -> (Is header?=w120)
    $"Is header?" <- w120
    Register Read(reference in="802.11 AFW Resources.grsc\\Check the ID") -> (data=w121)
    $"Check the ID" <- w121
    Register Read(reference in="802.11 AFW Resources.grsc\\Max ID") -> (data=w122)
    $"Index of Max ID" <- w122
  }
  FIFO Create(data type=CFXP(3.13) 0+0i, depth=17) -> (reference out=w123)
  FIFO Create(data type=CFXP(3.13) 0+0i, depth=1025) -> (reference out=w124)
  FIFO Create(data type=CFXP(3.13) 0+0i, depth=1025) -> (reference out=w125)
  FIFO Create(data type=UFXP(5.1) 0, depth=17) -> (reference out=w126)
  Property Node(instance in=T24 {all zero or empty}, "RF to RX FIFO"=w123, "internal loopback FIFO"=w124, "TX to RF FIFO"=w125, "Gain Settings FIFO"=w126) -> (instance out=w127)
  clock-driven loop (clock = "802.11 AFW Resources.grsc\\PHY") forever {
    Property Node(instance in=w21) -> ("global timestamp"=w128, "shared properties"=w129, "TX active"=w130, "OFDM symbol pulse"=w131)
    Register Read(reference in=w128) -> (data=w132)
    Property Node(instance in=w127) -> ("RF to RX FIFO"=w133, "internal loopback FIFO"=w134, "TX to RF FIFO"=w135, "Gain Settings FIFO"=w136)
    Register Read(reference in=w131) -> (data=w137, reference out=w138)
    Register Read(reference in=w129) -> (data=w139)
    # w137: Symbol trigger
    Property Node(instance in=w139) -> ("supported bandwidths"=w140, "DC centered signal"=w141, "channel selector"=w142)
    Feedback Node(input=w143) -> w144
    call "802.11 PHY-SAP Read PHY.gcdl"(PHY-SAP=w33, ready for output=w144) -> (PSDU=w145, PSDU valid=w146, PhyTxStart.req=w147)
    call "niInstr Basic Elements v1 FPGA.lvlib__Detect Rising Edge.gcdl"(signal=w137) -> (edge detected=w148)
    call "802.11 PHY TX Request Handler.gcdl"(symbol trigger in=w148, PhyTxStart.req=w147, supported bandwidths=w140) -> (symbol index=w149, symbol trigger out=w150, start of packet=w151, TX vector out=w152, PhyTxEnd.ind=w153, TX active=w154)
    Register Write(data=w154, reference in=w130) -> (reference out=w155)
    call "802.11 RX Data Source.gcdl"(RX data source=$"RX data source", mute RX while TX active?=$"mute RX while TX active?", TX active register=w155, RF to RX FIFO=w133, internal loopback FIFO=w134, OFDM symbol trigger register=w138, produce silent samples=$"produce silent samples", H2T FIFO="802.11 AFW Resources.grsc\\H2T RX Baseband") -> (sample=w156, output valid=w157)
    call "802.11 Signal Filter.gcdl"(sample in=w156, input valid=w157, configuration=w139) -> (20MHz sample out=w158, output valid=w159, 40MHz sample out=w160, 80MHz sample out=w161)
    Feedback Node(input=w162) -> w163
    call "802.11 Synchronization.gcdl"(bypass synchronization=$"bypass synchronization", rearm packet start generator=$"rearm packet start generator", packet start sample index=$"packet start sample index", synchronization settings=$"synchronization settings", rearm sychronization=w163, sample in=w156, input valid=w157, filtered sample=w158, filtered sample valid=w159) -> (sample out=w164, output valid=w165, packet start=w166, compensated CFO=w167, CCA signal detected=w168)
    w169 = T19 {"format"="a", "channel selector"=0, "device MAC address"=[0, 0, 0, 0, 0, 0], "DC centered signal"=FALSE, "supported bandwidths"={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}}
    Feedback Node(enable?=w166, initial value=w169, input=w139) -> w170
    Property Node(instance in=w170) -> ("format"=w171, instance out=w172)
    Feedback Node(input=w173) -> w174
    call "802.11 RX IQ Processing.gcdl"(sample=w164, input valid=w165, packet start=w166, configuration=w174) -> (subcarrier=w175, subcarrier timing=w176, subcarrier field map=w177, last sample received=w178, channel estimate=w179, channel estimate timing=w180)
    Feedback Node(input=w181) -> w182
    call "802.11 RX Bit Processing.gcdl"(subcarrier timing=w176, subcarrier=w175, field map=w177, configuration=w182, noise coefficient=$"noise coefficient") -> (current OFDM symbol=w183, PSDU=w184, bit=w185, bit valid=w186, last byte decoded=w187, PSDU valid=w188)
    call "802.11 RX PHY State Machine.gcdl"(bit=w185, bit valid=w186, shared properties=w172, current OFDM symbol=w183, last bit of packet decoded=w187, last sample of packet received=w178, global timestamp=w132) -> (RX bit processing configuration=w181, RX IQ processing configuration=w173, PhyRxStart.ind=w189, PhyRxEnd.ind=w190)
    Property Node(instance in=w190) -> ("valid"=w162)
    Feedback Node(input=w191) -> w192
    To Fixed Point(number=w192) -> w193: FXP(10.3) Saturate:ConvergentRounding
    Select(s=$"enable AGC", t=w193, f=$"RF gain") -> w194
    call "802.11 Power Measurement.gcdl"(sample=w161, input valid=w159, CCA energy detect threshold=$"CCA energy detect threshold", power calibration offset=$"power calibration offset", RF gain=w194, sample 20MHz filtered=w158, sample 40MHz filtered=w160) -> (signal power=w195, output valid=w196, out of range?=w197, CCA energy detect=w198, RF input power=w199)
    Property Node(instance in=T21 {all zero or empty}, "CCA energy detection busy"=w198, "CCA signal detection busy"=w168) -> (instance out=w200)
    call "802.11 AGC.gcdl"(signal power=w195, packet start=w166, rearm AGC=w163, AGC thresholds=$"AGC tresholds", AGC timeout=$"AGC timeout", signal power valid=w196, enable AGC=$"enable AGC") -> (gain=w201, trigger gain setting=w202, state=w203, last applied gain=w191)
    Property Node(instance in=T23 {all zero or empty}, "trigger gain setting"=w202, "gain"=w201) -> (instance out=w204)
    w205 = cluster{"AGC state": T22, "AGC enabled": bool} {all zero or empty}
    Property Node(instance in=w205, "AGC state"=w203, "AGC enabled"=$"enable AGC") -> (instance out=w206)
    call "802.11 PHY-SAP Write PHY.gcdl"(PHY-SAP=w33, PSDU valid=w188, PSDU=w184, CCA detection=w200, PhyRxEnd.ind=w190, PhyRxStart.ind=w189, PhyTxEnd.ind=w153, PHY RX Gain change indication=w204, PHY RX AGC state indication=w206)
    call "802.11 Prepare RX IQ Data for T2H.gcdl"(subcarrier=w175, timing=w176, field map=w177, FIFO reference="802.11 AFW Resources.grsc\\T2H Constellation") -> (FIFO overflow count=w207)
    $"T2H Constallation overflow" <- w207
    call "802.11 Prepare Channel Estimation for T2H.gcdl"(channel estimate=w179, timing=w180, format=w171, FIFO reference="802.11 AFW Resources.grsc\\T2H Channel Estimation") -> (FIFO overflow count=w208)
    $"T2H Channel Estimation overflow" <- w208
    call "802.11 Trigger Capture RX Samples.gcdl"(trigger condition=$"trigger condition", manual trigger=$"manual trigger", RX packet start=w166, TX active register=w155, CCA energy detected=w198) -> (trigger=w209)
    call "802.11 Capture RX Samples.gcdl"(sample=w164, input valid=w165, trigger=w209, number of samples to capture=$"number of samples to capture", FIFO reference="802.11 AFW Resources.grsc\\T2H RX Power Spectrum", number of samples before trigger=$"number of samples before trigger") -> (FIFO overflow count=w210)
    $"T2H RX Power Spectrum overflow" <- w210
    call "802.11 TX Bit Processing.gcdl"(symbol trigger=w150, OFDM symbol index=w149, TX vector=w152, PSDU=w145, input valid=w146) -> (bit=w211, output valid=w212, ready for input=w143, modulation=w213)
    call "802.11 TX IQ Processing.gcdl"(symbol trigger=w150, OFDM symbol index=w149, TX vector=w152, channel selector=w142, start of packet=w151, bit valid=w212, bit=w211, bit processing modulation=w213, DC centered signal=w141, supported bandwidths=w140) -> (data out=w214, output valid=w215)
    call "802.11 TX Data Sink.gcdl"(TX to RF FIFO=w135, internal loopback FIFO=w134, sample=w214, input valid=w215, T2H FIFO="802.11 AFW Resources.grsc\\T2H TX Baseband") -> (T2H FIFO overflow count=w216, TX to RF FIFO overflow count=w217, internal loopback FIFO overflow count=w218)
    $"T2H TX Baseband FIFO overflow" <- w216
    $"TX to RF FIFO overflow" <- w217
    $"compensated CFO" <- w167
    $"internal loopback FIFO overflow" <- w218
    call "802.11 RX Bit Processing Data Sink.gcdl"(PSDU=w184, input valid=w188, FIFO reference="802.11 AFW Resources.grsc\\T2H RX Bit Processing Output") -> (FIFO overflow count=w219)
    $"T2H RX Bit Processing Output FIFO overflow" <- w219
    call "802.11 TX Bit Processing Data Sink.gcdl"(bit=w211, input valid=w212, modulation=w213, FIFO reference="802.11 AFW Resources.grsc\\T2H TX Bit Processing Output") -> (FIFO overflow count=w220)
    $"T2H TX Bit Processing Output FIFO overflow" <- w220
    call "802.11 Capture PHY RX Indications.gcdl"(PHY RX start indication in=w189, PHY RX end indication in=w190) -> (PHY RX start indication out=w221, PHY RX end indication out=w222)
    $"PhyRxStart.ind" <- w221
    $"PhyRxEnd.ind" <- w222
    $"RF input power" <- w199
    Feedback Node(enable?=w166, input=w199) -> w223
    $"RF input power at packet start" <- w223
    $"signal power" <- w195
    Feedback Node(enable?=w166, input=w195) -> w224
    $"signal power at packet start" <- w224
    $"out of range?" <- w197
    FIFO Write(Control Protocol Input=w202, data=w201, reference in=w136)
    $"last applied gain" <- w191
  }
  call "Create Resources.gvi"() -> (config.resources=w225, sync.resources=w226, time.resources=w227)
  clock-driven loop (clock = "40 MHz Onboard Clock") {
    Io Write(data=$"RF 1/Rx/Enable", reference in="RF 1/Rx/Enable")
    Io Write(data=$"RF 0/Tx/Enable", reference in="RF 0/Tx/Enable")
    Io Write(data=$"RF 0/Rx/Enable", reference in="RF 0/Rx/Enable")
    Feedback Node(input=w228) -> w229
    Property Node(instance in=w127) -> ("Gain Settings FIFO"=w230)
    FIFO Read(Control Protocol Input=TRUE, reference in=w230) -> (Control Protocol Output=w228, data=w231)
    Feedback Node(enable?=w228, input=w231) -> w232
    To Fixed Point(number=w232) -> w233: UFXP(6.1) Wrap:Truncate
    # Register Bus and Required Controls/Indicators
    Scale By Power Of 2(n=1, x=w233) -> w234
    To Unsigned Byte Integer(number=w234) -> w235
    Property Node(instance in=T2 {"power enable"=TRUE, "mixer enable"=TRUE, "gain"=0}, "power enable"=$"power enable", "mixer enable"=$"mixer enable", "gain"=w235) -> (instance out=w236)
    call "Set Gain.gcdl"(ATR State=$"ATR State", Radio Control Destination=$"Radio Control Destination", FPGA.Fifo="802.11 AFW Resources.grsc\\AGC Reg Bus 0 Access FIFO", daughterboard=$daughterboard, antenna configuration=$"antenna configuration", Write ATR?=w229, lo lpf enable=$"lo lpf enable", rx.configuration=w236, tx.configuration=$"tx.configuration", spi address=$"spi address", cpld enable=$"cpld enable")
    Io Write(data=$"RF 1/Tx/Enable", reference in="RF 1/Tx/Enable")
    Feedback Node(input=w237) -> w238
    Property Node(instance in=w238) -> ("ready for port 0 input"=w239, "ready for port 1 input"=w240)
    Feedback Node(input=w241) -> w242
    call "niInstr Register Bus v1 FPGA.lvlib__Process.gcdl"(reg.notify host.go rcvd=$"reg.notify host.go rcvd 0", reg.host read.go rcvd=$"reg.host read.go rcvd 0", read completion=w242, reg.reset=$"reg.reset 0", reg.host instruction fifo="niInstr Register Bus v0.grsc\\reg.host instruction fifo 0", ready for output=w240) -> (reg.notify host.go=w243, reg.host read.data=w244, register instruction=w245)
    $"reg.notify host.go 0" <- w243
    $"reg.host read.data 0" <- w244
    FIFO Read(Control Protocol Input=w239, reference in="802.11 AFW Resources.grsc\\AGC Reg Bus 0 Access FIFO") -> (Control Protocol Output=w246, data=w247)
    call "Retrieve FPGA Scoped Instruction.gcdl"(number=w247, valid=w246) -> (output cluster=w248)
    Feedback Node(input=w249) -> w250
    call "niInstr Register Bus v1 FPGA.lvlib__Register Instruction Arbiter (2 inputs).gcdl"(port 0=w248, port 1=w245, reset=FALSE, ready for output=w250) -> (register instr out=w251, ready for input=w237)
    call "Registers.gcdl"(register instruction=w251, config.resources=w225, sync.resources=w226, time.resources=w227) -> (read completion out=w241, ready for input=w249)
    stop if FALSE
  }
  clock-driven loop (clock = "Data Clock") forever {
    # Baseband to/from RF conversion
    # Data Reception from Antenna, downconversion to baseband sample rate, received data will be written into RX baseband input FIFO
    # Reading of TX baseband FIFO, upconversion and transmission to antenna
    Property Node(instance in=w21) -> ("shared properties"=w252, "global timestamp"=w253, "OFDM symbol pulse"=w254)
    call "Mod N Indexer U16 v2.gcdl"(N=$"Data clock cycles per tick (0.1us)", enable=$"data clock locked?") -> (wrap back?=w255)
    call "niInstr Basic Elements v1 FPGA.lvlib__Count Up U32.gcdl"(increment=w255, reset=FALSE) -> (count out=w256)
    Register Write(data=w256, reference in=w253)
    call "Mod N Indexer U16 v2.gcdl"(N=$"Data clock cycles per OFDM symbol", enable=$"data clock locked?") -> (wrap back?=w257)
    Register Write(data=w257, reference in=w254)
    w258 = T18 {"5 MHz"=FALSE, "10 MHz"=FALSE, "20 MHz"=TRUE, "40 MHz"=TRUE, "80 Mhz"=FALSE, "160 MHz"=FALSE}
    w259 = T19 {"format"="a", "channel selector"=0, "device MAC address"=[0, 0, 0, 0, 0, 0], "DC centered signal"=FALSE, "supported bandwidths"={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}}
    Property Node(instance in=w259, "format"=$format, "channel selector"=$"channel selector", "device MAC address"=$"device MAC address", "DC centered signal"=$"DC centered signal", "supported bandwidths"=w258) -> (instance out=w260)
    Register Write(data=w260, reference in=w252)
    $Timestamp <- w256
    Property Node(instance in=w127) -> ("TX to RF FIFO"=w261, "RF to RX FIFO"=w262)
    Build Array($"rx 0.stream enable", $"rx 1.stream enable") -> w263
    w264 = T25 {"0x800000000000", 0, 0, "0x1FFFF", "0x1FFFF", 0, 0, 0, 0, 0, 0, 0}
    Property Node(instance in=w264, "impairments"=$"rx 0.impairments", "frequency shift"=$"rx 0.frequency shift", "phase"=$"rx 0.phase", "output sample rate"=$"rx.output sample rate", "delay"=$"rx.delay") -> (instance out=w265)
    w266 = T25 {"0x800000000000", 0, 0, "0x1FFFF", "0x1FFFF", 0, 0, 0, 0, 0, 0, 0}
    Property Node(instance in=w266, "delay"=$"rx.delay", "output sample rate"=$"rx.output sample rate", "impairments"=$"rx 1.impairments", "frequency shift"=$"rx 1.frequency shift", "phase"=$"rx 1.phase") -> (instance out=w267)
    Build Array(w265, w267) -> w268
    call "802.11 USRP Stream RX.gcdl"(RF to RX FIFO reference=w262, enable DC offset correction=$"enable DC offset correction", rx.reset=$"rx.reset", rx.rf channel=$"rx.rf channel", rx. stream enabled=w263, rx.abort=$"rx.abort", DDC parameters=w268) -> (rx.number of IQ data overflows=w269, rx.dsp reset done=w270, DC average=w271, rx.state=w272, rx.samples processed=w273, rx.number of overflows=w274)
    $"rx.number of IQ data overflows" <- w269
    Build Array($"tx 0.stream enable", $"tx 1.stream enable") -> w275
    w276 = T26 {0, "0x1FFFF", "0x1FFFF", 0, 0, 0, 0, 0, 0, 0, 0, "0x200000", "0x200000", 0}
    Property Node(instance in=w276, "gain"=$"tx 0.gain", "frequency shift"=$"tx 0.frequency shift", "phase"=$"tx 0.phase", "impairments"=$"tx 0.impairments", "input sample rate"=$"tx.input sample rate", "delay"=$"tx.delay") -> (instance out=w277)
    w278 = T26 {0, "0x1FFFF", "0x1FFFF", 0, 0, 0, 0, 0, 0, 0, 0, "0x200000", "0x200000", 0}
    Property Node(instance in=w278, "delay"=$"tx.delay", "input sample rate"=$"tx.input sample rate", "gain"=$"tx 1.gain", "frequency shift"=$"tx 1.frequency shift", "phase"=$"tx 1.phase", "impairments"=$"tx 1.impairments") -> (instance out=w279)
    Build Array(w277, w279) -> w280
    call "802.11 USRP Stream TX.gcdl"(tx.enable streams=w275, tx.reset=$"tx.reset", tx.rf channel=$"tx.rf channel", TX to RF FIFO reference=w261, tx.abort=$"tx.abort", DUC parameters=w280) -> (tx.state=w281, tx.samples processed=w282, tx.underflows=w283, tx.number of IQ data overflows=w284, tx.dsp reset done=w285)
    $"tx.state" <- w281
    $"rx.dsp reset done" <- w270
    $"tx.samples processed" <- w282
    $"rx.state" <- w272
    $"tx.underflows" <- w283
    $"rx.samples processed" <- w273
    $"tx.number of IQ data overflows" <- w284
    $"rx.number of overflows" <- w274
    $"tx.dsp reset done" <- w285
    $"DC average" <- w271
  }
  call "LEDs.gvi"()
  call "niUsrpRio Config v1 FPGA.lvlib__Process.gvi"(resources=w225)
